vi "2Point Linear Scale - Copy.gvi"   [LabVIEW NXG]
inputs:
  "Wvfrm In": waveform<f64> = {dt=1, Y=[]}
  "Cal Data": T1 = {"SP1 Value"=1, "SP1 Voltage"=0, "SP2 Voltage"=1, "SP2 Value"=0}
  "Slope in": f64 = NaN
  "Offest in": f64 = NaN
outputs:
  "Offest": f64
  "Slope": f64
  "Wvfrm Out": waveform<f64>
types:
  T1 = cluster{"SP1 Value": f64, "SP1 Voltage": f64, "SP2 Voltage": f64, "SP2 Value": f64}
diagram:
  # Slope = (X2-X1)/(Y2-Y1)
  # Offset = (X1-(slope*Y1)
  # Scaled Data = Data*Slope+Offset
  Property Node(instance in=$"Cal Data") -> ("SP1 Voltage"=w1, "SP2 Voltage"=w2, "SP1 Value"=w3, "SP2 Value"=w4)
  Subtract(x=w2, y=w1) -> w5
  Subtract(x=w4, y=w3) -> w6
  Divide(x=w5, y=w6) -> w7
  Is Not A Number Or Path Or Refnum(number=$"Slope in") -> w8
  Select(s=w8, t=w7, f=$"Slope in") -> w9
  Waveform Multiply($"Wvfrm In", w9) -> (error out=w10, o=w11)
  Multiply(w7, w3) -> w12
  Subtract(x=w1, y=w12) -> w13
  Is Not A Number Or Path Or Refnum(number=$"Offest in") -> w14
  Select(s=w14, t=w13, f=$"Offest in") -> w15
  Waveform Add(w11, w15, error in=w10) -> w16
  $"Wvfrm Out" <- w16
  $Slope <- w7
  $Offest <- w13
