vi "Circulation Lab.gvi"   [LabVIEW NXG]
panel controls:
  "stop": bool
  "Reset": bool
  "Threshold": f64
panel indicators:
  "Pulse Raw Signal (Ch1)": f64
  "Blood Pressure (kPa)": f64
  "Scaled Data History Chart": waveform<f64>
  "Blood Pressure Raw Signal (Ch2)": f64
  "Inst Pulse (bpm)": f64
  "Avg Pulse (bmp)": f64
  "Pulse Histroy Chart": waveform<f64>
diagram:
  # Configure
  # Mode: AI Voltage Input
  # Sampling: "On Demand"
  Task Resource() -> (task out=w1)
  while {
    Wait Until Next Ms Multiple(millisecond multiple=50)
    # Read in a voltage
    # for each channel
    Read Node[ChannelMultiplicity=Multiple, SampleMultiplicity=Multiple](task in=w1) -> (data=w2)
    Array Index(array=w2) -> (out0[_]=w3, out1[_]=w4)
    $"Pulse Histroy Chart" <- w3
    call "Pulse SubVI.gvi"(Waveform=w3, Threshold=$Threshold, Reset=$Reset, Rising Edges?=FALSE) -> (Inst Pulse Rate (bpm)=w5, Avg Pulse Rate (bmp)=w6)
    $"Inst Pulse (bpm)" <- w5
    $"Avg Pulse (bmp)" <- w6
    call "Statistics_Waveform_1Chan.gvi"(signal=w3) -> (mean=w7)
    $"Blood Pressure Raw Signal (Ch2)" <- w7
    call "2Point Linear Scale.gvi"(Wvfrm In=w4, Slope in=50, Offest in=10) -> (Wvfrm Out=w8)
    $"Scaled Data History Chart" <- w8
    call "Statistics_Waveform_1Chan.gvi"(signal=w8) -> (mean=w9)
    $"Blood Pressure (kPa)" <- w9
    call "Statistics_Waveform_1Chan.gvi"(signal=w4) -> (mean=w10)
    $"Pulse Raw Signal (Ch1)" <- w10
    stop if $stop
  }
