vi "Event Marker - Copy.gvi"   [LabVIEW NXG]
panel controls:
  "Sensor Channel": enum{"Channel 1", "Channel 2"} = "Channel 1"
  "stop": bool
panel indicators:
  "Raw Signal": f64
  "Data History Chart": waveform<f64>
  "Raw Signal (V)": f64
  "Button Press Duration": f64
  "Two Edge Seperation": f64
  "Rising Edge Times": timestamp[]
  "Falling Edge Times": timestamp[]
diagram:
  Task Resource() -> (task out=w1)
  # Mode: AI Voltage Input
  # Sampling: Continuous
  # Rate: 1000Hz
  while {
    # Set Cal Data Coef to match Chart
    # Read in a voltage
    # for each channel
    Read Node[ChannelMultiplicity=Multiple, SampleMultiplicity=Multiple](number of samples=50, task in=w1) -> (data=w2)
    Array Index(array=w2) -> (out0[$"Sensor Channel"]=w3)
    $"Data History Chart" <- w3
    call "Event Marker SubVI.gvi"(Waveform In=w3) -> (Two Edge Seperation=w4, Button Press Duration=w5, Rising Edge Times=w6, Falling Edge Times=w7)
    $"Button Press Duration" <- w5
    $"Two Edge Seperation" <- w4
    $"Falling Edge Times" <- w7
    $"Rising Edge Times" <- w6
    Property Node(instance in=w3) -> ("Y"=w8)
    Add Array Elements(numeric array=w8) -> (sum=w9)
    Array Size(array=w8) -> (size(s)=w10)
    Divide(x=w9, y=w10) -> w11
    $"Raw Signal (V)" <- w11
    $"Raw Signal" <- w11
    call "Statistics_Waveform_1Chan.gvi"(signal=w3)
    Wait Until Next Ms Multiple(millisecond multiple=50)
    stop if $stop
  }
