vi "Light & Laser - Copy.gvi"   [LabVIEW NXG]
panel controls:
  "Sensor Channel": enum{"Channel 1", "Channel 2"} = "Channel 1"
  "stop": bool
  "Input Limit": f64 = 2
panel indicators:
  "Data History Chart": waveform<f64>[]
  "Raw Signal": f64
  "Two Edge Seperation (Falling)": f64
  "Ch 1 Beam Break Duration (s)": f64
  "Ch 2 Beam Break Duration (s)": f64
diagram:
  Task Resource() -> (task out=w1)
  # Mode: AI Voltage
  # Sampling: Continous
  # Rate: 1000Hz
  while {
    Read Node[ChannelMultiplicity=Multiple, SampleMultiplicity=Multiple](task in=w1) -> (data=w2)
    Array Index(array=w2) -> (out0[$"Sensor Channel"]=w3)
    call "Statistics_Waveform_1Chan.gvi"(signal=w3) -> (mean=w4)
    $"Raw Signal" <- w4
    call "Light & Laser Sub VI.gvi"(Waveform Array=w2, Input Limit=$"Input Limit") -> (Waveform Array Out=w5, Two Edge Seperation (Falling)=w6, Ch 1 Beam Break Duration (s)=w7, Ch 2 Beam Break Duration (s)=w8)
    $"Data History Chart" <- w5
    $"Two Edge Seperation (Falling)" <- w6
    $"Ch 1 Beam Break Duration (s)" <- w7
    $"Ch 2 Beam Break Duration (s)" <- w8
    stop if $stop
  }
