vi "Light & Laser Periodic.gvi"   [LabVIEW NXG]
panel controls:
  "stop": bool
  "Input Limit": f64 = 2
  "Sensor Channel": enum{"Channel 1", "Channel 2"} = "Channel 1"
  "Reset": bool
panel indicators:
  "Data History Chart": waveform<f64>
  "Raw Signal": f64
  "Beam Break Durration (s)": f64[]
  "Rising Edge Delta t (s)": f64[]
diagram:
  Task Resource() -> (task out=w1)
  # Mode: AI Voltage
  # Sampling: Continous
  # Rate: 1000Hz
  while {
    Wait Until Next Ms Multiple(millisecond multiple=50)
    Read Node[ChannelMultiplicity=Multiple, SampleMultiplicity=Multiple](task in=w1) -> (data=w2)
    Array Index(array=w2) -> (out0[$"Sensor Channel"]=w3)
    call "Statistics_Waveform_1Chan.gvi"(signal=w3) -> (mean=w4)
    $"Raw Signal" <- w4
    $"Data History Chart" <- w3
    call "Light & Laser Periodic SubVI.gvi"(Waveform In=w3, Threshold=$"Input Limit", Reset=$Reset) -> (Beam Break Durration (s)=w5, Rising Edge Delta t (s)=w6)
    $"Beam Break Durration (s)" <- w5
    $"Rising Edge Delta t (s)" <- w6
    stop if $stop
  }
