vi "Light & Laser Sub VI - Copy.gvi"   [LabVIEW NXG]
inputs:
  "Waveform Array": waveform<f64>[], required
  "Reset Count": bool
  "Input Limit": f64 = 2
outputs:
  "Waveform Array Out": waveform<f64>[]
  "Chan 1 Count": i32
  "Two Edge Seperation (Falling)": f64
  "Ch 1 Beam Break Duration (s)": f64
  "Ch 2 Beam Break Duration (s)": f64
panel indicators:
  "Edge Times": T1
types:
  T1 = cluster{"Chan 1 Rising Edges": timestamp[], "Chan 1 Falling Edges": timestamp[], "Chan 2 Falling Edges": timestamp[], "Chan 2 Rising Edges": timestamp[]}
diagram:
  $"Waveform Array Out" <- $"Waveform Array"
  Array Index(array=$"Waveform Array") -> (out0[_]=w1, out1[_]=w2)
  Property Node(instance in=w2) -> ("Y"=w3)
  Is Greater(x=w3, y=$"Input Limit") -> w4
  Property Node(instance in=w1) -> ("t0"=w5, "dt"=w6, "Y"=w7)
  Is Greater(x=w7, y=$"Input Limit") -> w8
  s1 = uninitialised  # shift register
  s2 = i32[] []  # shift register
  s3 = i32[] []  # shift register
  s4 = uninitialised  # shift register
  s5 = i32[] []  # shift register
  s6 = i32[] []  # shift register
  for (iteration -> i1) {
    w9 = each element of w8
    w10 = each element of w4
    Is First Call() -> w11
    Not(x=w11) -> w12
    Is Greater(x=w9, y=s1) -> w13
    Logical And(w12, w13) -> w14
    case (w14) {
      frame False, Default {
        w15 = s2
      }
      frame True {
        Build Array[ConcatenateInputs=True](s2, i1) -> w15
      }
    }
    Is Less(x=w9, y=s1) -> w16
    Logical And(w12, w16) -> w17
    case (w17) {
      frame False, Default {
        w18 = s3
      }
      frame True {
        Build Array[ConcatenateInputs=True](s3, i1) -> w18
      }
    }
    Is Greater(x=w10, y=s4) -> w19
    Logical And(w12, w19) -> w20
    case (w20) {
      frame False, Default {
        w21 = s5
      }
      frame True {
        Build Array[ConcatenateInputs=True](s5, i1) -> w21
      }
    }
    Is Less(x=w10, y=s4) -> w22
    Logical And(w12, w22) -> w23
    case (w23) {
      frame False, Default {
        w24 = s6
      }
      frame True {
        Build Array[ConcatenateInputs=True](s6, i1) -> w24
      }
    }
    next s1 = w9
    next s2 = w15
    next s3 = w18
    next s4 = w10
    next s5 = w21
    next s6 = w24
  }
  Array Size(array=s2) -> (size(s)=w25)
  s7 = uninitialised  # shift register
  while {
    Add(s7, w25) -> w26
    Is First Call() -> w27
    Logical Or(w27, $"Reset Count") -> w28
    Select(s=w28, t=0, f=w26) -> w29
    next s7 = w29
    stop if TRUE
  }
  $"Chan 1 Count" <- s7
  Multiply(w6, s2) -> w30
  for {
    w31 = each element of w30
    Time Stamp Add(x=w5, y=w31) -> w33
    append w33 to w32
  }
  call "Store Last N Timestamps.gvi"(Input Array=w32) -> (Timestamp Array=w34)
  Multiply(w6, s5) -> w35
  for {
    w36 = each element of w35
    Time Stamp Add(x=w5, y=w36) -> w38
    append w38 to w37
  }
  call "Store Last N Timestamps.gvi"(Input Array=w37) -> (Timestamp Array=w39)
  Multiply(w6, s3) -> w40
  for {
    w41 = each element of w40
    Time Stamp Add(x=w5, y=w41) -> w43
    append w43 to w42
  }
  call "Store Last N Timestamps.gvi"(Input Array=w42) -> (Timestamp Array=w44)
  Multiply(w6, s6) -> w45
  for {
    w46 = each element of w45
    Time Stamp Add(x=w5, y=w46) -> w48
    append w48 to w47
  }
  call "Store Last N Timestamps.gvi"(Input Array=w47) -> (Timestamp Array=w49)
  Build Cluster(w34, w44, w39, w49) -> w50
  $"Edge Times" <- w50
  Array Index(array=w34) -> (out0[_]=w51)
  Array Index(array=w44) -> (out0[_]=w52)
  # Most recent rising edge minus
  # most recent falling edge
  Subtract(x=w51, y=w52) -> w53
  $"Ch 1 Beam Break Duration (s)" <- w53
  Array Index(array=w49) -> (out0[_]=w54)
  # Subtract two most recent falling edges
  Subtract(x=w54, y=w52) -> w55
  $"Two Edge Seperation (Falling)" <- w55
  Array Index(array=w39) -> (out0[_]=w56)
  Subtract(x=w56, y=w54) -> w57
  $"Ch 2 Beam Break Duration (s)" <- w57
