vi "Microphone Input - Copy.gvi"   [LabVIEW NXG]
panel controls:
  "stop": bool
panel indicators:
  "Scaled Data History Chart": waveform<f64>
  "Raw Signal (V)": f64
  "Raw Signal": f64
diagram:
  Task Resource() -> (task out=w1)
  # Configure
  # Mode: Audio Input
  # Sampling: Continuous
  # Rate: 44100 Hz
  while {
    Read Node[SampleMultiplicity=Multiple](number of samples=882, task in=w1) -> (data=w2)
    $"Scaled Data History Chart" <- w2
    call "Statistics_Waveform_1Chan.gvi"(signal=w2) -> (mean=w3)
    $"Raw Signal" <- w3
    $"Raw Signal (V)" <- w3
    stop if $stop
  }
