vi "Store Last N Values - Copy.gvi"   [LabVIEW NXG]
inputs:
  "Value": f64 = NaN, required
  "N (20)": i32 = 20
  "Reset": bool
outputs:
  "Element Array": f64[]
diagram:
  # This function will store an array of values pt by pt
  s1 = uninitialised  # shift register
  while {
    Is First Call() -> w1
    Logical Or(w1, $Reset) -> w2
    call "Count Iteration.gvi"(Reset=w2) -> (Iteration=w3)
    Max And Min(x=w3, y=$"N (20)") -> (min(x,y)=w4: i32)
    Quotient And Remainder(x=w3, y=$"N (20)") -> (x-y*floor(x/y)=w5)
    Increment(x=w5) -> w6
    case (w2) {
      frame False, Default {
        w7 = s1
      }
      frame True {
        Initialize Array(element=$Value, size=$"N (20)") -> w7
      }
    }
    Replace Array Subset(inArray=w7, w5, $Value) -> w8
    Reverse 1D Array(array=w8) -> (reversed array=w9)
    Rotate 1D Array(array=w9, n=w6) -> (array (last n elements first)=w10)
    Array Subset(array=w10, length0=w4) -> w11
    next s1 = w8
    stop if TRUE
  }
  $"Element Array" <- w11
