vi "Thermistor - Copy.gvi"   [LabVIEW NXG]
panel controls:
  "Sensor Channel": enum{"Channel 1", "Channel 2"} = "Channel 1"
  "stop": bool
  "K coefficients": f64[] = [0.00073998, 0.00027874, 9.26e-08]
panel indicators:
  "Raw Signal": f64
  "Scaled Signal": f64
  "Scaled Data History Chart": f64
  "Raw Signal (V)": f64
diagram:
  # Configure
  # Mode: AI Voltage Input
  # Sampling: "On Demand"
  Task Resource() -> (task out=w1)
  while {
    call "Statistics_Waveform_1Chan.gvi"(signal=_) -> (mean=w2)
    call "Volts to C.gvi"(Voltage=w2, K coefficients=$"K coefficients") -> (Temperature (C)=w3)
    $"Scaled Data History Chart" <- w3
    # Read in a voltage
    # for each channel
    Read Node[ChannelMultiplicity=Multiple, SampleMultiplicity=Multiple](task in=w1) -> (data=w4)
    Array Index(array=w4)
    $"Scaled Signal" <- w3
    call "Statistics_Waveform_1Chan.gvi"(signal=_) -> (mean=w5)
    $"Raw Signal (V)" <- w5
    $"Raw Signal" <- w5
    stop if $stop
  }
