vi "Volts to C - Copy.gvi"   [LabVIEW NXG]
inputs:
  "Voltage": f64
  "K coefficients": f64[] = [0.00073998, 0.00027874, 9.26e-08]
outputs:
  "Temperature (C)": f64
diagram:
  Array Index(array=$"K coefficients") -> (out0[0]=w1)
  Array Index(array=$"K coefficients") -> (out0[1]=w2)
  Divide(x=10, y=$Voltage) -> w3
  Decrement(x=w3) -> w4
  Divide(x=10000, y=w4) -> w5
  Natural Logarithm(x=w5) -> w6
  Multiply(w6, w2) -> w7
  Array Index(array=$"K coefficients") -> (out0[2]=w8)
  Natural Logarithm(x=w5) -> w9
  Power Of X(x=w9, y=3) -> w10
  Multiply(w10, w8) -> w11
  Add(w11, w7, w1) -> w12
  Reciprocal(x=w12) -> w13
  Subtract(x=w13, y=273.15) -> w14
  $"Temperature (C)" <- w14
