vi "Water Quality Lab.gvi"   [LabVIEW NXG]
panel controls:
  "Cal Data Ch1": T1 = {"SP1 Value"=8, "SP1 Voltage"=0.015, "SP2 Voltage"=0.18, "SP2 Value"=4.01}
  "stop": bool
  "Cal Data Ch2": T1 = {"SP1 Value"=100, "SP1 Voltage"=3.11, "SP2 Voltage"=1, "SP2 Value"=0}
panel indicators:
  "Ph Raw Signal (Ch1)": f64
  "Ph": f64
  "Scaled Data History Chart": waveform<f64>[]
  "Raw Signal (V)": f64
  "O2 Raw Signal (Ch2)": f64
  "O2 Saturation": f64
  "Raw Signal (V) 2": f64
types:
  T1 = cluster{"SP1 Value": f64, "SP1 Voltage": f64, "SP2 Voltage": f64, "SP2 Value": f64}
diagram:
  # Configure
  # Mode: AI Voltage Input
  # Sampling: "On Demand"
  Task Resource() -> (task out=w1)
  while {
    Wait Until Next Ms Multiple(millisecond multiple=50)
    # Read in a voltage
    # for each channel
    Read Node[ChannelMultiplicity=Multiple, SampleMultiplicity=Multiple](task in=w1) -> (data=w2)
    Array Index(array=w2) -> (out0[_]=w3, out1[_]=w4)
    # Set Cal Data Coef to match Chart
    call "2Point Linear Scale.gvi"(Wvfrm In=w3, Cal Data=$"Cal Data Ch1") -> (Wvfrm Out=w5)
    call "Statistics_Waveform_1Chan.gvi"(signal=w5) -> (mean=w6)
    $Ph <- w6
    call "Statistics_Waveform_1Chan.gvi"(signal=w3) -> (mean=w7)
    $"Raw Signal (V)" <- w7
    $"Ph Raw Signal (Ch1)" <- w7
    call "2Point Linear Scale.gvi"(Wvfrm In=w4, Cal Data=$"Cal Data Ch2") -> (Wvfrm Out=w8)
    Build Array(w5, w8) -> w9
    $"Scaled Data History Chart" <- w9
    call "Statistics_Waveform_1Chan.gvi"(signal=w8) -> (mean=w10)
    $"O2 Saturation" <- w10
    call "Statistics_Waveform_1Chan.gvi"(signal=w4) -> (mean=w11)
    $"Raw Signal (V) 2" <- w11
    $"O2 Raw Signal (Ch2)" <- w11
    stop if $stop
  }
