vi "iWorx - Sensor Template - Copy.gvi"   [LabVIEW NXG]
panel controls:
  "Cal Data": T1 = {"SP1 Value"=0.1, "SP1 Voltage"=0.3, "SP2 Voltage"=0.005, "SP2 Value"=0}
  "Sensor Channel": enum{"Channel 1", "Channel 2"} = "Channel 1"
  "stop": bool
panel indicators:
  "Raw Signal": f64
  "Scaled Signal": f64
  "Scaled Data History Chart": f64
  "Raw Signal (V)": f64
types:
  T1 = cluster{"SP1 Value": f64, "SP1 Voltage": f64, "SP2 Voltage": f64, "SP2 Value": f64}
diagram:
  # Configure
  # Mode: AI Voltage Input
  # Sampling: "On Demand"
  Task Resource() -> (task out=w1)
  while {
    # Read in a voltage
    # for each channel
    Read Node[ChannelMultiplicity=Multiple, SampleMultiplicity=Multiple](task in=w1) -> (data=w2)
    Array Index(array=w2) -> (out0[$"Sensor Channel"]=w3)
    # Set Cal Data Coef to match Chart
    call "2Point Linear Scale.gvi"(Wvfrm In=w3, Cal Data=$"Cal Data") -> (Wvfrm Out=w4)
    call "Statistics_Waveform_1Chan.gvi"(signal=w4) -> (mean=w5)
    $"Scaled Data History Chart" <- w5
    $"Scaled Signal" <- w5
    call "Statistics_Waveform_1Chan.gvi"(signal=w3) -> (mean=w6)
    $"Raw Signal (V)" <- w6
    $"Raw Signal" <- w6
    stop if $stop
  }
